vi "AM.gvi"   [LabVIEW NXG 5.0.0]
inputs:
  "frequency": f64 = 10
  "amplitude": f64 = 1
  "frequency_2": f64 = 10
  "phase in": f64
  "amplitude_2": f64 = 1
  "sample rate": f64 = 1000
  "samples": i32 = 1000
  "t0": timestamp = 1-01-01T00:00:00Z
  "phase in_2": f64
  "sample rate_2": f64 = 1000
  "samples_2": i32 = 1000
  "t0_2": timestamp = 1-01-01T00:00:00Z
outputs:
  "Message PSD": T1
  "Message Signal": waveform<f64>
  "AM Signal": waveform<f64>
  "AM PSD": T1
  "Carrier Signal": waveform<f64>
types:
  T1 = cluster{"f0": f64, "df": f64, "magnitude": f64[]}
uses:
  NI::Analysis::Generation::Sine Waveform.gvi
  NI::Analysis::Measurement::Power Spectral Density for 1 Chan.gvi
  NI::Analysis::Measurement::Power Spectrum for 1 Chan.gvi
diagram:
  call "Sine Waveform.gvi"(sample rate=$"sample rate", samples=$samples, t0=$t0, amplitude=$amplitude, frequency=$frequency, phase in=$"phase in") -> (sine wave=w1)
  $"Message Signal" <- w1
  call "Power Spectral Density for 1 Chan.gvi"(signal=w1) -> (power spectral density=w2)
  $"Message PSD" <- w2
  call "Sine Waveform.gvi"(sample rate=$"sample rate_2", samples=$samples_2, t0=$t0_2, amplitude=$amplitude_2, frequency=$frequency_2, phase in=$"phase in_2") -> (sine wave=w3)
  Waveform Add(w1, $amplitude_2) -> w4
  Waveform Multiply(w4, w3) -> w5
  $"AM Signal" <- w5
  $"Carrier Signal" <- w3
  call "Power Spectrum for 1 Chan.gvi"(signal=w5) -> (power spectrum=w6)
  $"AM PSD" <- w6
