vi "AMEnvelopeDetection.gvi"   [LabVIEW NXG 5.0.0]
inputs:
  "AM signal": waveform<f64> = {dt=1, Y=[]}
  "cutoff frequency": f64 = 0.125
  "order": i32 = 2
outputs:
  "time_view": waveform<f64>
  "frequency_view": T1
types:
  T1 = cluster{"f0": f64, "df": f64, "magnitude": f64[]}
uses:
  NI::Analysis::Filtering::Butterworth Lowpass Filter (Waveform).gvi
  NI::Analysis::Measurement::Power Spectrum for 1 Chan.gvi
diagram:
  Property Node(instance in=$"AM signal") -> ("Y"=w1, "t0"=w2, "dt"=w3, "attributes"=w4)
  for {
    w5 = each element of w1
    Is Greater Or Equal(x=w5, y=0) -> w7
    Select(s=w7, t=w5, f=0) -> w8
    append w8 to w6
  }
  Build Waveform Node(Y=w6, attributes=w4, dt=w3, t0=w2) -> (output waveform=w9)
  call "Butterworth Lowpass Filter (Waveform).gvi"(signal=w9, cutoff frequency=$"cutoff frequency", order=$order) -> (filtered signal=w10)
  $time_view <- w10
  call "Power Spectrum for 1 Chan.gvi"(signal=w10) -> (power spectrum=w11)
  $frequency_view <- w11
