vi "AMTopLevel.gvi"   [LabVIEW NXG 5.0.0]
panel controls:
  "order": i32 = 2
  "cutoff frequency": f64 = 0.125
  "message_amplitude": f64 = 1
  "message_frequency": f64 = 10
  "sample rate": f64 = 1000
  "samples": i32 = 1000
  "carrier_amplitude": f64 = 1
  "carrier_frequency": f64 = 10
  "stop": bool
panel indicators:
  "envelope_time_view": waveform<f64>
  "coherent_time_view": waveform<f64>
  "coherent_frequency_view": T1
  "envelope_frequency_view": T1
types:
  T1 = cluster{"f0": f64, "df": f64, "magnitude": f64[]}
diagram:
  while {
    call "AM.gvi"(amplitude=$message_amplitude, frequency=$message_frequency, sample rate=$"sample rate", samples=$samples, amplitude_2=$carrier_amplitude, frequency_2=$carrier_frequency, sample rate_2=$"sample rate", samples_2=$samples) -> (AM Signal=w1, Carrier Signal=w2)
    call "AMEnvelopeDetection.gvi"(AM signal=w1, cutoff frequency=$"cutoff frequency", order=$order) -> (time_view=w3, frequency_view=w4)
    $envelope_time_view <- w3
    $envelope_frequency_view <- w4
    call "AMCoherent.gvi"(AM signal=w1, Carrier signal=w2, cutoff frequency=$"cutoff frequency", order=$order) -> (time_view=w5, frequency_view=w6)
    $coherent_time_view <- w5
    $coherent_frequency_view <- w6
    stop if $stop
  }
