vi "BPSK_Tx_Rx_Template.gvi"   [LabVIEW NXG 5.0.0]
panel controls:
  "IQ rate": f64 = 200000
  "device names": "USRP niUSRPClass"
  "carrier frequency": f64 = 400000000
  "gain Tx": f64
  "active antenna Tx": string = "TX1"
  "stop Tx": bool
  "gain Rx": f64
  "active antenna Rx": string = "RX2"
  "symbol rate": f64
  "total bits": i32 = 128
panel indicators:
  "Baseband Power Spectrum_Tx": T1
  "output waveform": waveform<f64>
  "Baseband Waveform": waveform<f64>
  "Baseband Power Spectrum_Rx": T1
  "Output bits": i16[]
  "BER": f64
  "trigger found?": bool
types:
  T1 = cluster{"f0": f64, "df": f64, "magnitude": f64[]}
uses:
  NI::Modulation::MT Generate Bits (Galois, PN Order).gvi
  NI::Analysis::Resampling::Upsample (DBL).gvi
  NI::Modulation::MT Generate Filter Coefficients.gvi
  NI::Analysis::Operations::1D Convolution (DBL).gvi
  NI::USRP::niUSRP Open Rx Session.gvi
  NI::USRP::niUSRP Configure Signal.gvi
  NI::USRP::niUSRP Initiate.gvi
  NI::USRP::niUSRP Fetch Rx Data (CDB).gvi
  NI::USRP::niUSRP Open Tx Session.gvi
  NI::USRP::niUSRP Write Tx Data (CDB).gvi
  NI::USRP::niUSRP Close Session.gvi
  NI::Analysis::Resampling::Decimate (single shot, DBL).gvi
  NI::Modulation::MT Calculate BER After Trigger (PN Sequence).gvi
diagram:
  # Transmitter
  Reciprocal(x=$"IQ rate") -> w1
  Divide(x=$"IQ rate", y=$"symbol rate") -> w2
  call "MT Generate Bits (Galois, PN Order).gvi"(total bits=$"total bits", PN sequence order=9) -> (output bit stream=w3)
  for {
    w4 = each element of w3
    Multiply(w4, 2) -> w6
    Subtract(x=w6, y=1) -> w7
    append w7 to w5
  }
  call "AddFrameHeader.gvi"(array=w5) -> (output array=w8)
  call "Upsample (DBL).gvi"(signal=w8, upsampling factor=w2) -> (upsampled signal=w9)
  call "MT Generate Filter Coefficients.gvi"(pulse shaping filter="Root Raised Cos", pulse shaping samples per symbol=w2, modulation type="PSK") -> (pulse shaping filter coefficients=w10)
  call "1D Convolution (DBL).gvi"(x=w9, y=w10) -> (x * y=w11)
  call "Quick Scale 1D.gvi"(X=w11) -> (Y[i]=X[i]/Max|X|=w12)
  Build Waveform Node(Y=w12, dt=w1) -> (output waveform=w13)
  $"output waveform" <- w13
  w14 = cluster{"t0": timestamp, "dt": f64, "Y": c128[]} {all zero or empty}
  Property Node(instance in=w14, "dt"=w1, "Y"=w12) -> (instance out=w15)
  call "FFT Power Spectrum for 1 Chan (CDB)2.gvi"(time signal=w15, dB On (F)=TRUE) -> (power spectrum=w16)
  $"Baseband Power Spectrum_Tx" <- w16
  w17 = cluster{"t0": timestamp, "dt": f64, "Y": c128[]} {all zero or empty}
  call "MT Generate Filter Coefficients.gvi"(pulse shaping filter="Root Raised Cos", matched samples per symbol=w2, modulation type="PSK") -> (matched filter coefficients=w18)
  call "niUSRP Open Rx Session.gvi"(device names=$"device names") -> (session handle out=w19, error out=w20)
  call "niUSRP Configure Signal.gvi"(active antenna=$"active antenna Rx", session handle=w19, error in=w20, IQ rate=$"IQ rate", carrier frequency=$"carrier frequency", gain=$"gain Rx") -> (session handle out=w21, error out=w22, coerced carrier frequency=w23)
  Subtract(x=w23, y=20000) -> w24
  Property Node(instance in=w21, "niUSRP"=w24) -> (instance out=w25)
  call "niUSRP Initiate.gvi"(session handle=w25, error in=w22) -> (session handle out=w26, error out=w27)
  call "niUSRP Fetch Rx Data (CDB).gvi"(session handle=w26, error in=w27, number of samples=1000000) -> (session handle out=w28, error out=w29, data=w30)
  call "FrameSync (Complex).gvi"(Sampled Input=w30) -> (Aligned Samples=w31)
  call "Channel Estimator.gvi"(input signal=w31) -> (signal out=w32)
  Complex To Real And Imaginary(x + iy=w32) -> w33
  call "1D Convolution (DBL).gvi"(x=w33, y=w18) -> (x * y=w34)
  Property Node(instance in=w17, "dt"=w1, "Y"=w34) -> (instance out=w35)
  call "FFT Power Spectrum for 1 Chan (CDB)2.gvi"(time signal=w35, dB On (F)=TRUE) -> (power spectrum=w36)
  $"Baseband Power Spectrum_Rx" <- w36
  Build Waveform Node(Y=w34, dt=w1) -> (output waveform=w37)
  $"Baseband Waveform" <- w37
  call "niUSRP Open Tx Session.gvi"(device names=$"device names") -> (session handle out=w38, error out=w39)
  call "niUSRP Configure Signal.gvi"(active antenna=$"active antenna Tx", session handle=w38, error in=w39, IQ rate=$"IQ rate", carrier frequency=$"carrier frequency", gain=$"gain Tx") -> (session handle out=w40, error out=w41)
  # Receiver
  Real And Imaginary To Complex(x=w12, y=f64[] []) -> w42
  call "Insert Pilots.gvi"(signal input=w42) -> (output signal=w43)
  call "AddFrameHeader (complex).gvi"(array=w43) -> (output array=w44)
  while {
    call "niUSRP Write Tx Data (CDB).gvi"(session handle=w40, error in=w41, data=w44) -> (session handle out=w45, error out=w46)
    stop if $"stop Tx"
  }
  call "niUSRP Close Session.gvi"(session handle=w45, error in=w46)
  call "PulseAlign (Real).gvi"(Input signal=w34, Receiver Sampling Factor=w2) -> (aligned output=w47)
  call "Decimate (single shot, DBL).gvi"(signal=w47, decimating factor=w2) -> (decimated signal=w48)
  call "FrameSync (Real).gvi"(Sampled Input=w48) -> (Aligned Samples=w49)
  for {
    w50 = each element of w49
    Is Greater Than 0(x=w50) -> w52
    Boolean To 0 Or 1(Boolean=w52) -> (0, 1=w53)
    append w53 to w51
  }
  Array Subset(array=w51, index0=0, length0=$"total bits") -> w54
  call "MT Calculate BER After Trigger (PN Sequence).gvi"(input bit stream=w54, BER trigger threshold=0.4) -> (BER=w55, trigger found?=w56)
  $BER <- w55
  $"trigger found?" <- w56
  $"Output bits" <- w54
  call "niUSRP Close Session.gvi"(session handle=w28, error in=w29)
