vi "Function.gvi"   [LabVIEW NXG 5.0.0]
panel controls:
  "IQ rate": f64 = 200000
  "device names": "USRP niUSRPClass"
  "carrier frequency": f64 = 400000000
  "gain Tx": f64
  "active antenna Tx": string = "TX1"
  "stop Tx": bool
  "gain Rx": f64
  "active antenna Rx": string = "RX2"
  "symbol rate": f64
  "total bits": i32 = 128
panel indicators:
  "Baseband Waveform": waveform<f64>
  "Baseband Power Spectrum_Tx": T1
  "Baseband Power Spectrum_Rx": T1
  "output waveform": waveform<f64>
types:
  T1 = cluster{"f0": f64, "df": f64, "magnitude": f64[]}
uses:
  NI::Modulation::MT Generate Bits (Galois, PN Order).gvi
  NI::Analysis::Resampling::Upsample (DBL).gvi
  NI::Modulation::MT Generate Filter Coefficients.gvi
  NI::Analysis::Operations::1D Convolution (DBL).gvi
  NI::USRP::niUSRP Open Tx Session.gvi
  NI::USRP::niUSRP Configure Signal.gvi
  NI::USRP::niUSRP Write Tx Data (CDB).gvi
  NI::USRP::niUSRP Close Session.gvi
  NI::USRP::niUSRP Open Rx Session.gvi
  NI::USRP::niUSRP Initiate.gvi
  NI::USRP::niUSRP Fetch Rx Data (CDB).gvi
diagram:
  # Transmitter
  Reciprocal(x=$"IQ rate") -> w1
  Reciprocal(x=$"symbol rate") -> w2
  Divide(x=$"IQ rate", y=w2) -> w3
  w4 = $"total bits"
  Random Number() -> (number (0 to 1)=w5)
  call "MT Generate Bits (Galois, PN Order).gvi"(total bits=w4, PN sequence order=9, seed in=w5) -> (output bit stream=w6)
  for (N = w4) {
    w7 = each element of w6
    Multiply(w7, 2) -> w9
    Subtract(x=w9, y=1) -> w10
    append w10 to w8
  }
  call "AddFrameHeader.gvi"(array=w8) -> (output array=w11)
  call "Upsample (DBL).gvi"(signal=w11, upsampling factor=w3) -> (upsampled signal=w12)
  call "MT Generate Filter Coefficients.gvi"(pulse shaping filter="Root Raised Cos", pulse shaping samples per symbol=w3, modulation type="PSK") -> (pulse shaping filter coefficients=w13)
  call "1D Convolution (DBL).gvi"(x=w12, y=w13) -> (x * y=w14)
  call "Quick Scale 1D.gvi"(X=w14) -> (Y[i]=X[i]/Max|X|=w15)
  Build Waveform Node(Y=w15, dt=w1) -> (output waveform=w16)
  $"output waveform" <- w16
  # Receiver
  Real And Imaginary To Complex(x=w15, y=f64[] []) -> w17
  w18 = cluster{"t0": timestamp, "dt": f64, "Y": c128[]} {all zero or empty}
  Property Node(instance in=w18, "dt"=w1, "Y"=w17) -> (instance out=w19)
  call "FFT Power Spectrum for 1 Chan (CDB)2.gvi"(time signal=w19, dB On (F)=TRUE) -> (power spectrum=w20)
  $"Baseband Power Spectrum_Tx" <- w20
  w21 = cluster{"t0": timestamp, "dt": f64, "Y": c128[]} {all zero or empty}
  Property Node(instance in=w21) -> (instance out=w22)
  call "FFT Power Spectrum for 1 Chan (CDB)2.gvi"(time signal=w22, dB On (F)=TRUE) -> (power spectrum=w23)
  $"Baseband Power Spectrum_Rx" <- w23
  Build Waveform Node() -> (output waveform=w24)
  $"Baseband Waveform" <- w24
  call "niUSRP Open Tx Session.gvi"(device names=$"device names") -> (session handle out=w25, error out=w26)
  call "niUSRP Configure Signal.gvi"(active antenna=$"active antenna Tx", session handle=w25, error in=w26, IQ rate=$"IQ rate", carrier frequency=$"carrier frequency", gain=$"gain Tx") -> (session handle out=w27, error out=w28)
  call "Insert Pilots.gvi"(signal input=w17) -> (output signal=w29)
  call "AddFrameHeader (complex).gvi"(array=w29) -> (output array=w30)
  while {
    call "niUSRP Write Tx Data (CDB).gvi"(session handle=w27, error in=w28, data=w30) -> (session handle out=w31, error out=w32)
    stop if $"stop Tx"
  }
  call "niUSRP Close Session.gvi"(session handle=w31, error in=w32)
  call "niUSRP Open Rx Session.gvi"(device names=$"device names") -> (session handle out=w33, error out=w34)
  call "niUSRP Configure Signal.gvi"(active antenna=$"active antenna Rx", session handle=w33, error in=w34, IQ rate=$"IQ rate", carrier frequency=$"carrier frequency", gain=$"gain Rx") -> (session handle out=w35, error out=w36, coerced carrier frequency=w37)
  Subtract(x=w37, y=20000) -> w38
  Property Node(instance in=w35, "niUSRP"=w38) -> (instance out=w39)
  call "niUSRP Initiate.gvi"(session handle=w39, error in=w36) -> (session handle out=w40, error out=w41)
  call "niUSRP Fetch Rx Data (CDB).gvi"(session handle=w40, error in=w41, number of samples=1000000) -> (session handle out=w42, error out=w43)
  call "niUSRP Close Session.gvi"(session handle=w42, error in=w43)
